# Grasshopper definition gh_script.gh (Grasshopper 0.9.76)
# plug-ins: Python Interpreter

geometry = GeometryPipeline(
    GroupByLayer=False,
    GroupByType=False,
    IncludeHidden=True,
    IncludeLocked=True,
    LayerFilter="Geometry",
    NameFilter="*",
    TypeFilter=1073741848)
panel = Panel("0")
dom = ConstructDomain(DomainStart=expr("-x", "pi/4"), DomainEnd="pi/4")
dom_2 = ConstructDomain(DomainStart=expr("-x", "0"), DomainEnd="2*pi")
range = Range(Domain=dom, Steps=Slider(2, range=0..10))
range_2 = Range(Domain=dom_2, Steps=Slider(8, range=0..10))
crossref = CrossReference(ListA=range_2, ListB=range, CrossMode=1)  # -> ListA, ListB
volume = Volume(Geometry=geometry)  # -> Volume, Centroid
pt = PointPolar(BasePlane=graft(volume.Centroid), XYAngle=crossref.ListA, ZAngle=crossref.ListB, Offset=Slider(5, range=0..10))
bbox = BoundingBox(Content=geometry, Plane=PlaneXY(0, 0, 0))  # -> Box, Box_2
cullpt = CullDuplicates(Points=pt, Tolerance=0.1, CullMode=3)  # -> Points, Indices, Valence
debrep = DeconstructBrep(Brep=bbox.Box)  # -> Faces, Edges, Vertices

# ---- group: cpt
geo = Geometry(volume.Centroid)

# ----
python = PythonScript(sphere_tree_in=cullpt.Points, cpt_lst_in=geo, bound_srf_lst_in=debrep.Faces)  # -> sphere_out, cpt_out; inputs sphere_tree_in: tree, cpt_lst_in: list, bound_srf_lst_in: tree
# ---------- python: Python ----------
import rhinoscriptsyntax as rs
import Rhino as rc
import pprint
import scriptcontext as sc


""" Calculate View Factor 

"""
class ViewFactor(object):
    def __init__(self):
        self.sphere_nested = []
        self.cpt = []
        self.bound_nested = []
        
    def process_raw_inputs(self,sphere_tree_in,bound_srf_lst_in,cpt_lst_in):
        self.cpt = cpt_lst_in
        # convert tree to nested list of sphere pts
        for i in range(sphere_tree_in.BranchCount):
            branchList = sphere_tree_in.Branch(i)
            self.sphere_nested.append(branchList)
        
        # convert tree to nested list of bound srfs
        for i in range(bound_srf_lst_in.BranchCount):
            branchList = bound_srf_lst_in.Branch(i)
            self.bound_nested.append(branchList)
        
        # convert guids to brep 
        for i in xrange(len(self.sphere_nested)):
            sphere_per_bld = list(self.sphere_nested[i])
            for j in xrange(len(sphere_per_bld)):
                sphere_per_bld[j] = rs.coerce3dpoint(sphere_per_bld[j])
            self.sphere_nested[i] = sphere_per_bld
    
    def ray_cast(self,srf2int):
        """
        base_vector
        direction_vector
        srf2int
        """
        for i in xrange(self.sphere_nested):
            sphere_pt = self.sphere_nested[i]
            r0 = self.cpt#base_vector
            r1 = self.sphere#direction_vector
            
            ray = rc.Geometry.Ray3d(r0,r1)
            point_intersect_lst = rc.Geometry.Intersect.Intersection.RayShoot(ray,[srf2int],1)
            if point_intersect_lst:
                point_intersect_lst = list(point_intersect_lst)
                #debug.extend(point_intersect_lst)
                #debug.append(self.cpt)
        return point_intersect_lst

vf = ViewFactor()
vf.process_raw_inputs(sphere_tree_in, bound_srf_lst_in, cpt_lst_in)
vf.ray_cast()

sphere_out = vf.sphere_nested
cpt_out = vf.cpt
# ---------- end python ----------
panel_2 = Panel(python.sphere_out)
panel_3 = Panel(python.cpt_out)
panel_4 = Panel(cullpt.Points)
